# Grasshopper definition test.gh (Grasshopper 1.0.7)
# plug-ins: ICD.AbmFramework.Grasshopper

point = Point([Point(-1.28156237, -1.185547054, 0), Point(0.8290821744, 1.324758107, 0)])
c_script = CSharpScript(Reference=["C:\Users\77777777\AppData\Roaming\Grasshopper\Libraries\AgentBasedModelling.dll", "C:\Users\77777777\AppData\Roaming\Grasshopper\Libraries\ICD.AbmFramework.Core.dll"])  # -> out, A
# ---------- c_script: C# usings ----------
using AgentBasedModelling;
using ICD.AbmFramework.Core.Behavior;
using ICD.AbmFramework.Core.Agent;
# ---------- c_script: C# ----------
    ActiveCell c = new ActiveCell(0.0, 0.0, 0.0);
    CellEnvironment e = new CellEnvironment();
    WalkBehavior b = new WalkBehavior();

    c.Behaviors = new List<BehaviorBase>();
    c.Behaviors.Add(b);

    CellAgentSystem s = new CellAgentSystem();
    s.Agents = new List<AgentBase>();
    s.Agents.Add(c);

    A = s;
# ---------- end c_script ----------
xy_plane = XYPlane(Origin=point)
timer = Timer(TimerInterval=200, Target=c_script_2)
step_by_step_solver = StepByStepSolver(Reset=Button(), Execute=Toggle(True), AgentSystems=c_script.A)  # -> DisplayGeometries, AllAgentSystems, IterationCount
panel = Panel(c_script.A)
c_script_2 = CSharpScript(
    Reset=Button(),
    Execute=Toggle(True),
    Poses=xy_plane,
    Reference=["C:\Users\77777777\AppData\Roaming\Grasshopper\Libraries\AgentBasedModelling.dll", "C:\Users\77777777\AppData\Roaming\Grasshopper\Libraries\ICD.AbmFramework.Core.dll"])  # -> out, A; inputs Reset: Boolean, Execute: Boolean, Poses: list of Plane
# ---------- c_script_2: C# usings ----------
using AgentBasedModelling;
using ICD.AbmFramework.Core;
using ICD.AbmFramework.Core.Behavior;
using ICD.AbmFramework.Core.Agent;
using ICD.AbmFramework.Core.AgentSystem;
# ---------- c_script_2: C# ----------
    if(Reset) solver = init(Poses);
    if(Execute) solver.ExecuteSingleStep();



    // display
    CellAgentSystem s = solver.AgentSystems[0] as CellAgentSystem;
    A = s.Cells;
# ---------- c_script_2: C# additional code ----------
  Solver solver;

  static Solver init(List<Plane> Poses){
    Cell activeCell = new Cell(0, 0, true);
    Cell passiveCell = new Cell(0, 0, false);

    //CellEnvironment envir = new CellEnvironment();
    WanderBehavior behavior = new WanderBehavior();

    CellGroup g1 = new CellGroup(activeCell, behavior);
    CellGroup g2 = new CellGroup(passiveCell, behavior);
    g1.Pose = Poses[0];
    g2.Pose = Poses[1];

    //cell.Behaviors = new List<BehaviorBase>();
    //cell.Behaviors.Add(behavior);

    CellAgentSystem system = new CellAgentSystem(3.0);
    system.Agents = new List<AgentBase>();
    system.Agents.Add(g1);
    system.Agents.Add(g2);

    List<AgentSystemBase> systems = new List<AgentSystemBase>();
    systems.Add(system);

    Solver solver = new Solver(systems);
    return solver;
  }
# ---------- end c_script_2 ----------
c_script_3 = CSharpScript(Reference=["C:\Users\77777777\AppData\Roaming\Grasshopper\Libraries\AgentBasedModelling.dll", "C:\Users\77777777\AppData\Roaming\Grasshopper\Libraries\ICD.AbmFramework.Core.dll"])  # -> out, A
# ---------- c_script_3: C# ----------
    a += 1;
# ---------- c_script_3: C# additional code ----------
  int a = 0;
# ---------- end c_script_3 ----------
panel_2 = Panel(c_script_2.A)
